# Grasshopper definition vase.gh (Grasshopper 1.0.7)

# ---- group: Simple Vase
height = Slider(10, range=0..10)
y_slices = Slider(7, range=0..10)
width = Slider(10, range=0..10)
pt = ConstructPoint(XCoordinate=0, YCoordinate=0, ZCoordinate=0)
line = LineSDL(Start=pt, Direction=Vector(0, 0, 1), Length=height)
range = Range(Domain=Domain(0, 1), Steps=y_slices)
divide = DivideCurve(Curve=line, Count=y_slices, Kinks=False)  # -> Points, Tangents, Parameters
graph = GraphMapper(
    range,
    x0=0,
    x1=1,
    y0=0,
    y1=1,
    container_name="Bezier",
    cpx=[0, 0.2781457007, 0.5695364475, 1],
    cpy=[0.6014492512, 0.4782608747, 0.702898562, 0.5])
multiplication = Multiplication(A=graph, B=width)
circle = CircleCNR(Center=divide.Points, Normal=Vector(0, 0, 1), Radius=multiplication)
loft = Loft(Curves=circle, Options={Adjust=False, Closed=False, LoftEnds=0, LoftSimp=0, LoftType=0, Rebuild=10, Refit=0.01})

# ---- group: Input
points = Slider(5, range=0..10)
depth = Slider(3, range=0..10)
height_2 = Slider(15, range=0..50)
number_slider = Slider(7, range=0..100)
layers = Slider(3, range=0..10)

# ---- group: Outline
cir = Circle(Plane=PlaneXY(0, 0, 0), Radius=number_slider)
addition = Addition(A=number_slider, B=depth)
cir_2 = Circle(Plane=PlaneXY(0, 0, 0), Radius=addition)
multiplication_2 = Multiplication(A=points, B="2")
divide_2 = DivideCurve(Curve=cir, Count=points, Kinks=False)  # -> Points, Tangents, Parameters
divide_3 = DivideCurve(Curve=cir_2, Count=multiplication_2, Kinks=False)  # -> Points, Tangents, Parameters
dispatch = Dispatch(List=divide_3.Points, DispatchPattern=[True, False])  # -> ListA, ListB
weave = Weave(Pattern=[0, 1], Stream0=divide_2.Points, Stream1=dispatch.ListB, NullGaps=False)
pline = PolyLine(Vertices=weave, Closed=invert(False))

# ---- group: Height
range_2 = Range(Domain=height_2, Steps=layers)
Z = UnitZ(Factor=range_2)
move = Move(Geometry=pline, Motion=Z)  # -> Geometry, Transform

# ---- group: Rotation
range_3 = Range(Domain=Domain(0, 1), Steps=layers)

# ---- group: Input (continued)
graph_2 = GraphMapper(
    range_3,
    x0=0,
    x1=1,
    y0=0,
    y1=1,
    container_name="Bezier",
    cpx=[0, 0.4283615351, 0.5988645554, 1],
    cpy=[0.4782608747, 0.817286849, 0.06506788731, 0.4927536249])

# ---- group: Rotation (continued)
rotate = Rotate(Geometry=move.Geometry, Angle=graph_2, Plane=PlaneXY(0, 0, 0))  # -> Geometry, Transform
loft_2 = Loft(Curves=rotate.Geometry, Options={Adjust=False, Closed=False, LoftEnds=0, LoftSimp=0, LoftType=0, Rebuild=10, Refit=0.01})
